# Grasshopper definition IGM_examples.gh (Grasshopper 1.0.7)
# plug-ins: IG-Mesh, Kangaroo2 Components

mesh = Mesh(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)

# ----
# 01::IO + Info
mesh_2 = Mesh(mesh)
igmeshinfo = MeshInfo(Mesh=mesh_2)  # -> Vertex, Face, Centroid, Volume

# ----
# 03::Adjacency & Boundary
mesh_3 = Mesh(mesh)
iboundedge = BoundaryEdge(Mesh=mesh_3)  # -> BoundaryEdges, VertexIndicesOfTheBoundaryEdges, BoundaryTriangleIndices
iboundloop = BoundaryLoop(Mesh=mesh_3)  # -> BoundaryIndex, BoundaryVertex
igadjtt = TriangleTriangleAdjacency(Mesh=mesh_3)  # -> AdjacencyTTIndex, AdjacencyTTEdgeIndex
igadjvt = VertexTriangleAdjacency(Mesh=mesh_3)  # -> VT, VTI
iadjvv = VertexVertexAdjacency(Mesh=mesh_3)  # -> AdjacencyIdices, AdjacencyVertices

# ----
# 02::Basic Property
mesh_4 = Mesh(mesh)
inormals_c = CornerNormal(Mesh=mesh_4, DegreeThreshold=10)
inormals_v = VertexNormal(Mesh=mesh_4)
inormals_f = FaceNormal(Mesh=mesh_4)
ibarycenter = Barycenter(Mesh=mesh_4)

# ----
# 04::Mapping
# Similar to the Grasshopper default "Remap" for number ranges, RemapFtoV and RemapVtoF remap a set of scalar values bi-directional.
mesh_5 = Mesh(mesh)
pdecon = Deconstruct(Point=inormals_f)  # -> XComponent, YComponent, ZComponent
pdecon_2 = Deconstruct(Point=inormals_v)  # -> XComponent, YComponent, ZComponent
iremapfv = RemapDataFromFaceToVertex(Mesh=mesh_5, Scalar=pdecon.XComponent)
iremapvf = RemapDataFromVertexToFace(Mesh=mesh_5, Scalar=pdecon_2.ZComponent)
point_vis = Point_Vis(data=iremapvf)
pt = Point(ibarycenter)
mesh_vis = Mesh_Vis(M=mesh, data=iremapfv)
cloud = CloudDisplay(Points=pt, Colours=point_vis, Size=1, SpriteType=0)

crv = Curve(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)
crv_2 = Curve(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)
merge = Merge(Data1=crv, Data2=crv_2)
crv_3 = Curve(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)
crv_4 = Curve(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)
swp2 = Sweep2(Rail1=crv_3, Rail2=crv_4, Sections=merge, SameHeight=False)
triremesh = TriRemesh(Geometry=swp2, Length=5, Iterations=25)  # -> Triangulation, Dual, Creases
mesh_6 = Mesh(triremesh.Triangulation)
igboundloop = BoundaryLoop(Mesh=mesh_6)  # -> BoundaryIndex, BoundaryVertex
crv_cp = CurveClosestPoint(Point=igboundloop.BoundaryVertex, Curve=crv_3)  # -> Point, Parameter, Distance
crv_cp_2 = CurveClosestPoint(Point=igboundloop.BoundaryVertex, Curve=crv_4)  # -> Point, Parameter, Distance
smaller = SmallerThan(FirstNumber=crv_cp.Distance, SecondNumber=1)  # -> SmallerThan, OrEqualTo
smaller_2 = SmallerThan(FirstNumber=crv_cp_2.Distance, SecondNumber=1)  # -> SmallerThan, OrEqualTo
cull = CullPattern(List=igboundloop.BoundaryIndex, CullPattern=smaller.SmallerThan)
cull_2 = CullPattern(List=igboundloop.BoundaryIndex, CullPattern=smaller_2.SmallerThan)
lng = ListLength(List=cull)
lng_2 = ListLength(List=cull_2)
dup = DuplicateData(Data="0", Number=lng, Order=True)
dup_2 = DuplicateData(Data="1", Number=lng_2, Order=True)
merge_2 = Merge(Data1=cull, Data2=cull_2)
merge_3 = Merge(Data1=dup, Data2=dup_2)
igconstrainedscalar = ConstrainedScalar(Mesh=mesh_6, ConstraintIndex=merge_2, ConstraintValue=merge_3)
gradient = Gradient(
    LowerLimit=0,
    UpperLimit=1,
    Parameter=igconstrainedscalar,
    stops=[0: RGB(234, 38, 0), 0.25: RGB(234, 126, 0), 0.5: RGB(254, 244, 84), 0.75: RGB(173, 203, 249), 1: RGB(75, 107, 169)])
mcol = MeshColours(Mesh=mesh_6, Colours=gradient)
igisoline = Isoline(Mesh=mcol, MeshScalar=igconstrainedscalar, IsolineT=Slider(0.7, range=0..1))
pline = PolyLine(Vertices=igisoline, Closed=False)

# ----
# 06::Utils
# Constrained Scalar:
# 
# By giving a set of pre-constrained vertices with constrained values, this component compute a gradient scalar fields over the mesh.
# 
# The scalar field can be used for extracting info over the mesh (isolines, for instance).
# 
# 
# Mesh Isoline:
# 
# This component uses a scalar field input over the mesh and extract points with the same value.
# 
# The component provides a similar but more general function to the corresponding function "NURBS Isolines".
# Quad Mesh Planarization.
# 
# Planarize a quad mesh interatively until the limit is reached or threshold is met.
# 
# This exmaple also contains the use of "planarity" and "Mesh Colors Face" components.
mesh_7 = Mesh(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)

# ----
# Random Points on Mesh:
# 
# Generate given number of random points.
# 
# method 0: randomly.
# method 1: uniformly (Poisson's disk distribution).
mesh_8 = Mesh(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)
number_slider = Slider(426, range=0..500)
irandomptsmesh = RandomPointsOnMesh(Mesh=mesh_8, Number=number_slider, Method="0")  # -> SampledPoints, FaceIndex
irandomptsmesh_2 = RandomPointsOnMesh(Mesh=mesh_8, Number=number_slider, Method="1")  # -> SampledPoints, FaceIndex
swatch = ColourSwatch(SwatchColor=RGB(31, 169, 255))
cloud_2 = CloudDisplay(Points=irandomptsmesh.SampledPoints, Colours=swatch, Size=1, SpriteType=0)
cloud_3 = CloudDisplay(Points=irandomptsmesh_2.SampledPoints, Colours=swatch, Size=0.7, SpriteType=0)

# ----
# 05::Measure
# Winding Number:
# 
# A robust method for determined inside and outside for open/close meshes.
# Signed Distance:
# 
# Provide 4 different approaches to compute the signed distance to a given mesh from a list of queried points.
# 
# For more details, check the two following paper:
# [Jacobson, Kavan Sorking-Hornug 2013]
# Dickson, Schmidt, Levin, Jacobson 2018]
# Principal Curvature:
# 
# Provides two sets of vectors and values for the max/min curvature at vertices.
# 
# Can be combined with the "RemapVtoF" to generate face-based curvatures.
# Mean Curvature:
# 
# Can be computed using the principal curvature:
# 
# K_m = 0.5 * (K_1 + K_2)
# Gaussian Curvature:
# 
# The default Gaussian curvature is defined via the vertex’s angular deficit, suiting for discrete settings. This may cause the curvature to accumulate to one ends when the mesh quality is bad or the mesh is not water-tight.
# 
# For the original definition, users can get from the principal curvature buy calculating:
# 
# K_G = K_1 * K_2
# Fast Geodesic Distance
# 
# Using the "heat kernal" methods to approximately calculating the geodesic distance on the given mesh.
# 
# Very Fast!
mesh_9 = Mesh(mesh)
lng_3 = ListLength(List=irandomptsmesh.SampledPoints)
pop3d = Populate3D(Region=mesh_9, Count=lng_3, Seed=1)
panel = Panel("""600
299""")
pt_2 = Point(pop3d)
pt_3 = Point(pop3d)
iggeodist = HeatGeoDistance(Mesh=mesh_9, Source=panel, ReCompute=False)
iwindingnum = WindingNumber(Mesh=mesh_9, QueryPoints=pt_2)
iprincipalcurvature = PrincipalCurvature(Mesh=mesh_9, Radius=5)  # -> PrincipalDir1, PrincipalDir2, PrincipalValue1, PrincipalValue2
isigneddis = SignedDistance(Mesh=mesh_9, QueryPoints=pt_3, Signed_type=4)  # -> SignedDistance, ClosestFaceIndex, ClosestPoint
expression = Expression(x=iprincipalcurvature.PrincipalValue1, y=iprincipalcurvature.PrincipalValue2, Expression="0.5*(x+y)")
expression_2 = Expression(x=iprincipalcurvature.PrincipalValue1, y=iprincipalcurvature.PrincipalValue2, Expression="x*y")
igcurvaturegaussian = GaussianCurvature(Mesh=mesh_9)
bnd = Bounds(Numbers=iggeodist)
point_vis_2 = Point_Vis(data=iwindingnum)
point_vis_3 = Point_Vis(data=isigneddis.SignedDistance)
dedomain = DeconstructDomain(Domain=bnd)  # -> Start, End
data = Data(expression_2)
gradient_2 = Gradient(
    LowerLimit=dedomain.Start,
    UpperLimit=dedomain.End,
    Parameter=iggeodist,
    stops=[0: RGB(234, 38, 0), 0.0875: RGB(234, 126, 0), 0.5: RGB(254, 244, 84), 0.75: RGB(173, 203, 249), 1: RGB(75, 107, 169)])
bnd_2 = Bounds(Numbers=data)
cloud_4 = CloudDisplay(Points=pt_3, Colours=point_vis_3, Size=1, SpriteType=0)
cloud_5 = CloudDisplay(Points=pt_2, Colours=point_vis_2, Size=1, SpriteType=0)
mesh_vis_2 = Mesh_Vis(M=mesh_4, data=iprincipalcurvature.PrincipalValue2)
mesh_vis_3 = Mesh_Vis(M=mesh_4, data=expression)
remap = RemapNumbers(Value=data, Source=bnd_2, Target=Domain(0, 1))  # -> Mapped, Clipped
gradient_3 = Gradient(
    LowerLimit=0,
    UpperLimit=1,
    Parameter=remap.Mapped,
    stops=[0: RGB(234, 38, 0), 0.0981: RGB(234, 126, 0), 0.192: RGB(254, 244, 84), 0.344: RGB(173, 203, 249), 0.524: RGB(75, 107, 169)])
mcol_2 = MeshColours(Mesh=mesh_9, Colours=gradient_2)
mcol_3 = MeshColours(Mesh=mesh_9, Colours=gradient_3)

# ----
# vertex moved dist.
number_slider_2 = Slider(0.01, range=0..0.1)
igquadplanarize = PlanarizeQuadMesh(Mesh=mesh_7, Iter=Slider(50, range=0..100), Thres=number_slider_2)  # disabled
mesh_10 = Mesh(igquadplanarize)
demesh = DeconstructMesh(Mesh=mesh_10)  # -> Vertices, Faces, Colours, Normals
demesh_2 = DeconstructMesh(Mesh=mesh_7)  # -> Vertices, Faces, Colours, Normals
igquadplanarity = QuadMeshPlanarity(Mesh=mesh_10)
subtraction = Subtraction(A=demesh.Vertices, B=demesh_2.Vertices)
gradient_4 = Gradient(
    LowerLimit=Slider(0.01, range=0..0.01),
    UpperLimit=0,
    Parameter=igquadplanarity,
    stops=[0: RGB(234, 38, 0), 0.25: RGB(234, 126, 0), 0.5: RGB(254, 244, 84), 0.75: RGB(173, 203, 249), 1: RGB(75, 107, 169)])
vlen = VectorLength(Vector=subtraction)
panel_2 = Panel(vlen)
igmeshcolorface = MeshColorFace(Mesh=mesh_10, Color=gradient_4)

mesh_11 = Mesh(mesh_7)
igquadplanarity_2 = QuadMeshPlanarity(Mesh=mesh_11)
gradient_5 = Gradient(
    LowerLimit=Slider(0.01, range=0..0.01),
    UpperLimit=0,
    Parameter=igquadplanarity_2,
    stops=[0: RGB(234, 38, 0), 0.25: RGB(234, 126, 0), 0.5: RGB(254, 244, 84), 0.75: RGB(173, 203, 249), 1: RGB(75, 107, 169)])
igmeshcolorface_2 = MeshColorFace(Mesh=mesh_11, Color=gradient_5)

number_slider_3 = Slider(0.56, range=0..1)
data_2 = Data(igmeshinfo.Vertex)
amp = Amplitude(Vector=iprincipalcurvature.PrincipalDir2, Amplitude=number_slider_3)
amp_2 = Amplitude(Vector=iprincipalcurvature.PrincipalDir1, Amplitude=number_slider_3)
vdisex = VectorDisplayEx(Point=data_2, Vector=amp, Colour=ColourSwatch(SwatchColor=RGB(0, 162, 255)), Width=2)
vdisex_2 = VectorDisplayEx(Point=data_2, Vector=amp_2, Colour=ColourSwatch(SwatchColor=RGB(255, 0, 174)), Width=2)

# ==== cluster Point_Vis
data = ClusterInput()
data_2 = Data(data)
bnd = Bounds(Numbers=data_2)
remap = RemapNumbers(Value=data_2, Source=bnd, Target=Domain(0, 1))  # -> Mapped, Clipped
gradient = Gradient(
    LowerLimit=0,
    UpperLimit=1,
    Parameter=remap.Mapped,
    stops=[0: RGB(234, 38, 0), 0.194: RGB(234, 126, 0), 0.5: RGB(254, 244, 84), 0.75: RGB(173, 203, 249), 1: RGB(75, 107, 169)])
C = ClusterOutput(gradient)

# ==== cluster Mesh_Vis
data = ClusterInput()
data_2 = Data(data)
bnd = Bounds(Numbers=data_2)
remap = RemapNumbers(Value=data_2, Source=bnd, Target=Domain(0, 1))  # -> Mapped, Clipped
gradient = Gradient(
    LowerLimit=0,
    UpperLimit=1,
    Parameter=remap.Mapped,
    stops=[0: RGB(234, 38, 0), 0.194: RGB(234, 126, 0), 0.5: RGB(254, 244, 84), 0.75: RGB(173, 203, 249), 1: RGB(75, 107, 169)])
M = ClusterInput()
mcol = MeshColours(Mesh=M, Colours=gradient)
M_2 = ClusterOutput(mcol)
